# Grasshopper definition rammeprogram.gh (Grasshopper 0.9.76)
# plug-ins: Python Interpreter

# ---- group: Cluster Indhold
explode = Explode(Recursive=True)  # -> Segments, Vertices
eval = EvaluateCurve(Curve=reparameterize(explode.Segments), Parameter=0.5)  # -> Point, Tangent, Angle
sort_pt = SortPoints(Points=flatten(eval.Point))  # -> Points, Indices
tstat = TreeStatistics(Tree=eval.Point)  # -> Paths, Length, Count
item = ListItem(List=tstat.Paths, Index=sort_pt.Indices, Wrap=True)
branch = TreeBranch(Tree=explode.Segments, Path=item, MaintainPaths=False)
explode_2 = Explode(Curve=branch, Recursive=True)  # -> Segments, Vertices
sort_pt_2 = SortPoints(Points=flatten(explode_2.Vertices))  # -> Points, Indices
pdecon = Deconstruct(Point=sort_pt_2.Points)  # -> XComponent, YComponent, ZComponent
pt = ConstructPoint(XCoordinate=pdecon.XComponent, YCoordinate=pdecon.YComponent, ZCoordinate=0)
bbox = BoundingBox(Content=pt, Plane=PlaneXY(0, 0, 0), UnionBox=True)  # -> Box, Box_2
area = Area(Geometry=bbox.Box)  # -> Area, Centroid
division = Division(A=area.Area, B=1500)
cullpt = CullDuplicates(Points=pt, Tolerance=0.1, CullMode=3)  # -> Points, Indices, Valence
cp = ClosestPoint(Point=explode_2.Vertices, Cloud=cullpt.Points)  # -> ClosestPoint, CPIndex, Distance
eval_2 = EvaluateCurve(Curve=reparameterize(flatten(explode_2.Segments)), Parameter=0.5)  # -> Point, Tangent, Angle
item_2 = ListItem(List=cp.CPIndex, Index=0, Wrap=True)  # -> Item, Item1
points = PointList(Points=cullpt.Points, Size=division)
points_2 = PointList(Points=eval_2.Point, Size=division)
pt_2 = ConstructPoint(XCoordinate=item_2.Item, YCoordinate=item_2.Item1, ZCoordinate=0)  # -> flatten(Point)

# ----
crv = Curve([<curve referenced from the Rhino model> x5])
crv_2 = Curve([<curve referenced from the Rhino model> x5])

# ----
# OLD
cluster = Cluster(C=crv_2)  # -> nodes, topolist
panel = Panel("""0,1,0
1,2,0
2,3,0
3,4,0
4,5,0
5,6,0
6,7,0
7,8,0
8,9,0
9,10,0
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""")  # disabled
panel_2 = Panel("""0,20
10,20
20,20
30,20
40,20
50,20
60,20
70,20
80,20
90,20
100,20
110,20
120,20
0,0
10,5.23
20,9.51
30,12.84
40,15.21
50,16.64
60,17.12
70,16.64
80,15.21
90,12.84
100,9.51
110,5.23
120,0""")  # disabled
pt_3 = Point(panel)  # disabled
pt_4 = Point(panel_2)  # disabled
panel_3 = Panel("""     14 11
14 2 0
                      14 6 0
                      26 1 0
                      26 2 0
                      1 2 0
                      7 1 0
                      13 2 0""")  # disabled
pdecon_2 = Deconstruct(Point=panel)  # -> XComponent, YComponent, ZComponent; disabled
lng = ListLength(List=cluster.nodes)
int = Integer(pdecon_2.XComponent)  # disabled
int_2 = Integer(pdecon_2.YComponent)  # disabled
series = Series(Start=0, Step=1, Count=lng)
lng_2 = ListLength(List=pt_4)  # disabled
xy = XYPlane(Origin=pt_4)  # disabled
bbox_2 = BoundingBox(Content=pt_4, Plane=PlaneXY(0, 0, 0), UnionBox=True)  # -> Box, Box_2; disabled
int_3 = Integer(series)
item_3 = ListItem(List=pt_4, Index=int, Wrap=True)  # disabled
item_4 = ListItem(List=pt_4, Index=int_2, Wrap=True)  # disabled
python = PythonScript(topolist=pt_3, nodes=pt_4)  # -> out, elements; inputs topolist: list, nodes: list; disabled
# ---------- python: Python ----------
import rhinoscriptsyntax as rs
import scriptcontext
import Rhino
scriptcontext.doc = ghdoc
startpoint=[]
endpoint=[]
eleProp=[]
elements=[]

for topo in topolist:
    indices=str(rs.PointCoordinates(topo)).split(",")
    stpt=nodes[int(indices[0])]
    enpt=nodes[int(indices[1])]
    startpoint.append(stpt)
    endpoint.append(enpt)
    elements.append(rs.AddLine(stpt,enpt))
    #eleProp.append(nodes[indices[2]])
# ---------- end python ----------
series_2 = Series(Start=0, Step=1, Count=lng_2)  # disabled
crv_3 = Curve(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)  # disabled
crv_4 = Curve(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)  # disabled
crv_5 = Curve(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)  # disabled
python_2 = PythonScript()  # -> out, elements; inputs topolist: list, nodes: list; same code as python
pt_5 = Point(cluster.nodes)
area_2 = Area(Geometry=bbox_2.Box)  # -> Area, Centroid; disabled
series_3 = Series(Start=0, Step=1, Count=10)  # disabled
ln = Line(StartPoint=item_3, EndPoint=item_4)  # disabled
python_3 = PythonScript(points=pt_5, height=Slider(2, range=0..10))  # -> out, numbering; inputs points: list of Point3d
# ---------- python_3: Python ----------
import rhinoscriptsyntax as rs
import scriptcontext as sc
import Rhino as r
rs.EnableRedraw(False)
plane=[]
for pt in points:
    plane.append(rs.MovePlane(rs.WorldXYPlane(),pt))

sc.doc = r.RhinoDoc.ActiveDoc

numbering =[]
for i in range(len(plane)):
    preText = rs.AddText(str(i), plane[i], height)
    textGeo = rs.ExplodeText(preText, True)
    
    for i in textGeo:
        numbering.append(rs.coercegeometry(i))
        rs.DeleteObject(i)
sc.doc = ghdoc
rs.EnableRedraw(True)
# ---------- end python_3 ----------
merge = Merge(Data1=crv_3, Data2=crv_4, Data3=crv_5)  # disabled
panel_4 = Panel("""14,1
14,2
14,3
26,1
26,2
1,2
7,1
13,2""")  # disabled
int_4 = Integer(series_2)  # disabled
division_2 = Division(A=area_2.Area, B=1000)  # disabled
scale = Scale(Geometry=merge, Center=Point(0, 0, 0), Factor=division_2)  # -> Geometry, Transform; disabled
tag = TextTag3D(Location=pt_4, Text=int_4, Size=division_2, Justification=7)  # disabled
panel_5 = Panel(python_2.elements)

python_4 = PythonScript()  # inputs Toggle: Boolean, Curves: list of Curve
# ---------- python_4: Python ----------
import Rhino as rc
import random as rnd

# Create a custom display
if "display" not in globals():
    display = rc.Display.CustomDisplay(True)
    
# Clear the display each time the script is run
display.Clear()

# Iterate the curves and add them to the custom display

for i,crv in enumerate(Curves):
    color = rc.Display.ColorHSL(0.7,1.0,0.5)
    display.AddCurve(crv,color,3)
# ---------- end python_4 ----------
toggle = BooleanToggle(True)
toggle_2 = BooleanToggle(True)
toggle_3 = BooleanToggle(True)

# ---- group: ElementTopology
python_5 = PythonScript(incurves=crv, sortEle=Toggle(True), sortNod=Toggle(False), TxtHeight=Slider(0.405, range=0..10))  # -> nodes, elements, ElePlanes, StartIndex, EndIndex, EleNum, NodNum; inputs incurves: list
# ---------- python_5: Python ----------
import rhinoscriptsyntax as rs
import scriptcontext as sc
import Rhino as rh
#sc.doc = ghdoc
def SortCurvesMid(curves):
    points=[]
    indices=[]
    
    for curve in curves:
        points.append(rs.CurveMidPoint(curve))
    sortedpts=rs.SortPoints(points,True)
    for point in points:
        indices.append(sortedpts.index(point))
    sortin,sortLines = zip(*sorted(zip(indices, curves)))
    return sortLines
def SafeExplodeCrv(inCurves):
    curves=[]
    
    for crv in inCurves:
        if rs.IsPolyline(crv) or rs.IsPolyCurve(crv):
            curves.extend(rs.ExplodeCurves(crv))
        else:
            curves.append(crv)
    return curves
def SortEndPtsUnique(lines):
    sortPts=[]
    lines2=[]
    for line in lines:
        endPts=[rs.CurveStartPoint(line),rs.CurveEndPoint(line)]
        endPts=rs.SortPoints(endPts)
        lines2.append(rs.AddLine(endPts[0],endPts[1]))
        for endPt in endPts:
            if sortPts.count(endPt)==0:
                sortPts.append(endPt)
    return sortPts, lines2
def EndPtsUnique(lines):
    pts=[]
    for line in lines:
        endPts=[rs.CurveStartPoint(line),rs.CurveEndPoint(line)]
        for endPt in endPts:
            if pts.count(endPt)==0:
                pts.append(endPt)
    return pts
def TextPreview(basepoints,preString,height):
    rs.EnableRedraw(False)
    plane=[]
    for pt in basepoints:
        plane.append(rs.MovePlane(rs.WorldXYPlane(),pt))
    
    sc.doc = rh.RhinoDoc.ActiveDoc
    
    numbering =[]
    for i in range(len(plane)):
        preText = rs.AddText(str(preString[i]), plane[i], height,justification=131074)
        textGeo = rs.ExplodeText(preText, True)
        for i in textGeo:
            numbering.append(rs.coercegeometry(i))
            rs.DeleteObject(i)
    sc.doc = ghdoc
    rs.EnableRedraw(True)
    return numbering

curves=SafeExplodeCrv(incurves)

elements=[]
nodes=[]
for curve in curves:
    elements.append(rs.AddLine(rs.CurveStartPoint(curve),rs.CurveEndPoint(curve)))

if sortEle:
    elements=SortCurvesMid(elements)
if sortNod:
    nodes,elements=SortEndPtsUnique(elements)
else:
    nodes=EndPtsUnique(elements)

StartIndex=[]
EndIndex=[]
for element in elements:
    StartIndex.append(nodes.index(rs.CurveStartPoint(element)))
    EndIndex.append(nodes.index(rs.CurveEndPoint(element)))

#Preview numbering
midpoints=[rs.CurveMidPoint(element) for element in elements]
EleNum=TextPreview(midpoints,range(len(midpoints)),TxtHeight)
NodNum=TextPreview(nodes,range(len(nodes)),TxtHeight)

ElePlanes=[]
for i in range(len(StartIndex)):
    xVector=rs.VectorUnitize(rs.VectorCreate(nodes[EndIndex[i]],nodes[StartIndex[i]]))
    ElePlanes.append(rs.PlaneFromNormal(nodes[StartIndex[i]],(0,0,1),xVector))
# ---------- end python_5 ----------

# ----
panel_6 = Panel(python_5.StartIndex)
int_5 = Integer([Slider(2, range=0..10), Slider(1, range=0..10)])
lng_3 = ListLength(List=python_5.elements)
neg = Negative(Value=Slider(11, range=0..100))
expression = Expression(x=Slider(2.1, range=0..10), Expression="x*10^11")
series_4 = Series(Start=0, Step=1, Count=lng_3)
vec = VectorXYZ(XComponent=0, YComponent=neg, ZComponent=0)  # -> Vector, Length

# ---- group: MatLabTranslator
python_6 = PythonScript(nodes=python_5.nodes, ElementStartIndex=python_5.StartIndex, ElementEndIndex=python_5.EndIndex)  # -> MatLabNodes, MatLabElements; inputs nodes: list, ElementStartIndex: list, ElementEndIndex: list
# ---------- python_6: Python ----------
import rhinoscriptsyntax as rs
i=1
MatLabNodes=""
for node in nodes:
    X,Y,Z = rs.PointCoordinates(node)
    nodesString= "X("+str(i)+",:) = ["+str(X)+" "+str(Y)+"];"
    MatLabNodes=MatLabNodes+nodesString+"\n"
    i+=1
MatLabNodes=MatLabNodes+"nno="+str(i-1)+";"

i=1
MatLabElements=""
ESI=ElementStartIndex
EEI=ElementEndIndex
for j in range(len(ElementStartIndex)):
    elementString= "T("+str(i)+",:) = ["+str(ESI[j]+1)+" "+str(EEI[j]+1)+"];"
    MatLabElements=MatLabElements+elementString+"\n"
    i+=1
MatLabElements=MatLabElements+"nel="+str(i-1)+";"
# ---------- end python_6 ----------

# ---- group: DOFS
python_7 = PythonScript(
    ElementStartIndex=python_5.StartIndex,
    ElementEndIndex=python_5.EndIndex,
    AddHingeNode=int_5,
    AddHingeElement=Slider(1, range=0..10))  # -> DegreesOfFreedom, NodeDOFS, MatLabDOFS; inputs ElementStartIndex: list of Int32, ElementEndIndex: list of Int32, AddHingeNode: list of Int32, AddHingeElement: list
# ---------- python_7: Python ----------
import rhinoscriptsyntax as rs
ESI=ElementStartIndex
EEI=ElementEndIndex
nodecount=max(ElementStartIndex+ElementEndIndex)-min(ElementStartIndex+ElementEndIndex)+1
dofcount=nodecount*3
AHE=AddHingeElement
AHN=AddHingeNode
#Repeat last element of shortest list
if len(AHE)<>0 and len(AHN)<>0:
    maxlen = max(len(AHE),len(AHN))
    AHE.extend([AHE[-1]]*(maxlen-len(AHE)))
    AHN.extend([AHN[-1]]*(maxlen-len(AHN)))
uninodes=[]
doflist=[]
DOFSlist=[]
rngstart=1
#Define no-hinge DOFS
for i in range(len(ESI)):
    if uninodes.count(ESI[i])==0:
        uninodes.append(ESI[i])
        dofstart=range(rngstart,rngstart+3)
        doflist.append(dofstart)
        rngstart=rngstart+3
    else:
        dofstart=doflist[uninodes.index(ESI[i])]
    
    if uninodes.count(EEI[i])==0:
        uninodes.append(EEI[i])
        dofend=range(rngstart,rngstart+3)
        doflist.append(dofend)
        rngstart=rngstart+3
    else:
        dofend=doflist[uninodes.index(EEI[i])]
    DOFS=dofstart+dofend
    DOFSlist.append(DOFS)

if len(AHN)<>0:
    #Add position of hinge
    for j in range(len(DOFSlist)):
        if len(AHE) == 0:
            for ahn in AHN:
                print inidof==ahn
                if ESI[j]==ahn:
                    DOFSlist[j][2]=0
                if EEI[j]==ahn:
                    DOFSlist[j][5]=0
        else:
            for ahe in AHE:
                if ahe==j:
                    for ahn in AHN:
                        if ESI[j]==ahn:
                            DOFSlist[j][2]=0
                        if EEI[j]==ahn:
                            DOFSlist[j][5]=0
    
    #Add hinge
    DOFSflat = [item for sublist in DOFSlist for item in sublist]
    while DOFSflat.count(0)<>0:
        m = range(1,len(DOFSflat))
        new=min(set(m)-set(DOFSflat))
        DOFSflat[DOFSflat.index(0)]=new
    newDOFSLIST=[]
    templist=[]
    for dofs in DOFSflat:
        templist.append(dofs)
        if len(templist)==6:
            newDOFSLIST.append(templist)
            templist=[]
    DOFSlist = newDOFSLIST
DegreesOfFreedom=[]
for defree in DOFSlist:
    DegreesOfFreedom.append(str(defree))

MatLabDOFS=""
for k, dofree in enumerate(DegreesOfFreedom):
    MatLabDOF= "D("+str(k+1)+",:)="+ dofree.replace(",","")+";\n"
    MatLabDOFS=MatLabDOFS+MatLabDOF
MatLabDOFS=MatLabDOFS+"nd="+str(max(DOFSflat))+";"

NodeDOFS=[]
for nodeNo in range(max(max(ESI),max(EEI))+1):
    for l,sdof in enumerate(DOFSlist):
        if nodeNo == ESI[l]:
            NodeDOFS.append(sdof[:3])
            break
        elif nodeNo ==EEI[l]:
            NodeDOFS.append(sdof[3:])
            break
NodeDOFS=str(NodeDOFS)
# ---------- end python_7 ----------

# ----
Y = UnitY(Factor=1)
Z = UnitZ(Factor=1)
num = Number([Slider(0.001, range=0..0.001), Slider(0.002, range=0..1)])
num_2 = Number(expression)
num_3 = Number(Slider(2e-06, range=0..1e-05))
rev = Reverse(Vector=Y)
int_6 = Integer(series_4)
python_8 = PythonScript(
    SupportNodesNo=[Slider(0, range=0..10), Slider(3, range=0..10), Slider(5, range=0..10)],
    NodeDOFS=python_7.NodeDOFS,
    LockX=[toggle_2, toggle, toggle_3],
    LockY=[toggle_2, toggle, toggle_3],
    LockRot=[toggle_2, toggle_3, Toggle(True), toggle])  # -> SupportDOFS, MatLabSupport; inputs SupportNodesNo: list of Int32, LockX: list of Boolean, LockY: list of Boolean, LockRot: list of Boolean
# ---------- python_8: Python ----------
listDOFS=NodeDOFS.replace("[","").replace("]","").replace(" ","").split(",")
SNN=SupportNodesNo
#Repeat last element of shortest list
if len(SNN)<>0 and len(LockX)<>0 and len(LockY)<>0 and len(LockRot)<>0:
    nodeLen = len(SNN)
    LockX.extend([LockX[-1]]*(nodeLen-len(LockX)))
    LockY.extend([LockY[-1]]*(nodeLen-len(LockY)))
    LockRot.extend([LockRot[-1]]*(nodeLen-len(LockRot)))
#Idiot sikring
LockX= LockX[:nodeLen]
LockY= LockY[:nodeLen]
LockRot= LockRot[:nodeLen]

SupportDOFS=[]
for i,snn in enumerate(SNN):
    dofsInd=range(snn*3,snn*3+3)
    if LockX[i]:
        SupportDOFS.append(listDOFS[dofsInd[0]])
    if LockY[i]:
        SupportDOFS.append(listDOFS[dofsInd[1]])
    if LockRot[i]:
        SupportDOFS.append(listDOFS[dofsInd[2]])
print SupportDOFS

MatLabSupport=""
for j,DOF in enumerate(SupportDOFS):
    MatLabSupport=MatLabSupport+"U("+str(j+1)+")="+DOF+";\n"
# ---------- end python_8 ----------
python_9 = PythonScript(
    LoadNodesNo=[Slider(1, range=0..1), Slider(2, range=0..10)],
    NodeDOFS=python_7.NodeDOFS,
    Direction=Vector(0, -1, 0),
    Newton=[Slider(20000, range=0..100000), Slider(20000, range=0..100000), Slider(20000, range=0..100000)])  # -> out, MatLabNodeLoads; inputs LoadNodesNo: list, Direction: list, Newton: list
# ---------- python_9: Python ----------
import rhinoscriptsyntax as rs
LNN=LoadNodesNo
listDOFS=NodeDOFS.replace("[","").replace("]","").replace(" ","").split(",")
if len(LNN)==0 or len(Direction)==0 or len(Newton)==0:
    MatLabNodeLoad="bL = [];"
else:
    #Repeat last element of shortest list
    nodeLen = len(LNN)
    Direction.extend([Direction[-1]]*(nodeLen-len(Direction)))
    Newton.extend([Newton[-1]]*(nodeLen-len(Newton)))
    Direction=Direction[:nodeLen]
    Newton=Newton[:nodeLen]
    
    vecX=[]
    vecY=[]
    for dir in Direction:
        #Unitize 2D vector
        vec=rs.VectorUnitize([dir[0],dir[1],0])
        vecX.append(vec[0])
        vecY.append(vec[1])
    
    MatLabNodeLoads=""
    j=1
    for i,lnn in enumerate(LNN):
        xstring= "bL("+str(j)+",:)=["+str(listDOFS[int(lnn)*3])+" "+str(Newton[i]*vecX[i])+"];\n"
        j+=1
        ystring= "bL("+str(j)+",:)=["+str(listDOFS[int(lnn)*3+1])+" "+str(Newton[i]*vecY[i])+"];\n"
        j+=1
        MatLabNodeLoads=MatLabNodeLoads+xstring+ystring
# ---------- end python_9 ----------
python_10 = PythonScript(
    LoadElementNo=[Slider(1, range=0..1), Slider(3, range=0..10)],
    ElePlanes=python_5.ElePlanes,
    Direction=vec.Vector,
    NPerM=Slider(20000, range=0..100000),
    Global=Toggle(True))  # -> MatLabElementLoad; inputs LoadElementNo: list of Int32, ElePlanes: list, Direction: list, NPerM: list, Global: list of Boolean
# ---------- python_10: Python ----------
import rhinoscriptsyntax as rs
LEN=LoadElementNo
MatLabElementLoad="dL = zeros(nel,2);\n"
if not (len(LEN)==0 or len(Direction)==0 or len(NPerM)==0 or len(ElePlanes)==0 or len(Global)==0):
    #Repeat last element of shortest list
    eleLen = len(LEN)
    Direction.extend([Direction[-1]]*(eleLen-len(Direction)))
    NPerM.extend([NPerM[-1]]*(eleLen-len(NPerM)))
    Global.extend([Global[-1]]*(eleLen-len(Global)))
    Direction=Direction[:eleLen]
    NPerM=NPerM[:eleLen]
    Global=Global[:eleLen]
    vecX=[]
    vecY=[]
    vecOri=[]
    for i,dir in enumerate(Direction):
        #Unitize 2D vector
        vec=rs.VectorUnitize([dir[0],dir[1],0])
        if Global[i]:
            line=rs.AddLine((0,0,0),vec)
            #vec=rs.XformCPlaneToWorld((0,0,0),ElePlanes[LEN[i]])
            vpt=rs.XformWorldToCPlane(vec,ElePlanes[LEN[i]])
            opt=rs.XformWorldToCPlane((0,0,0),ElePlanes[LEN[i]])
            #print rs.EvaluatePlane(ElePlanes[LEN[i]],[0,0])
            vec=rs.VectorCreate(vpt,opt)
        print vec
        MLx="dL("+str(LEN[i]+1)+",:)=[1 "+str(vec[0]*NPerM[i])+"];\n"
        MLy="dL("+str(LEN[i]+1)+",:)=[2 "+str(vec[1]*NPerM[i])+"];\n"
        MatLabElementLoad=MatLabElementLoad+MLx+MLy
# ---------- end python_10 ----------
python_11 = PythonScript(ElementNo=int_6, Emodul=num_2, SecArea=num, Inertia=num_3)  # -> out, materials, MatLabMaterial; inputs ElementNo: list of Int32, Emodul: list, SecArea: list, Inertia: list
# ---------- python_11: Python ----------
if not (len(Emodul)==0 or len(SecArea)==0 or len(Inertia)==0 or len(ElementNo)==0):
    #Repeat last element in list to get equal list lenght
    maxlen = len(ElementNo)
    SecArea.extend([SecArea[-1]]*(maxlen-len(SecArea)))
    Emodul.extend([Emodul[-1]]*(maxlen-len(Emodul)))
    Inertia.extend([Inertia[-1]]*(maxlen-len(Inertia)))
    SecArea=SecArea[:maxlen]
    Emodul=Emodul[:maxlen]
    Inertia=Inertia[:maxlen]
    
    MatLabMaterial=""
    materials=[]
    for i in range(maxlen):
        mate="G("+str(ElementNo[i]+1)+",:)=["+str(Emodul[i])+" "+str(SecArea[i])+" "+str(Inertia[i])+"];"
        materials.append("E-module="+str(Emodul[i])+" Area="+str(SecArea[i])+" Inertia="+str(Inertia[i]))
        MatLabMaterial=MatLabMaterial+mate+"\n"
else:
    print "Zero length lists do NOT work"
# ---------- end python_11 ----------
panel_7 = Panel(python_6.MatLabNodes)
panel_8 = Panel(python_7.MatLabDOFS)
panel_9 = Panel(python_6.MatLabElements)
panel_10 = Panel(python_8.MatLabSupport)
panel_11 = Panel(python_9.MatLabNodeLoads)
panel_12 = Panel(python_11.materials)
panel_13 = Panel(python_10)
panel_14 = Panel(python_11.MatLabMaterial)
button = Button()
python_12 = PythonScript(
    MatLabNodes=python_6.MatLabNodes,
    MatLabElements=python_6.MatLabElements,
    MatLabDOFS=python_7.MatLabDOFS,
    MatLabMaterial=python_11.MatLabMaterial,
    MatLabSupport=python_8.MatLabSupport,
    MatLabNodeLoads=python_9.MatLabNodeLoads,
    MatLabElementLoad=python_10,
    PlotScalingDeformation=5,
    PlotScalingForces=3e-05,
    run=Button(),
    refresh=Toggle(True))  # -> out, MLstring, resultfile, deformationfile, deformationcurves; inputs PlotScalingDeformation: list, PlotScalingForces: list, run: Boolean
# ---------- python_12: Python ----------
import os
import subprocess
import Grasshopper as GH
import time
import rhinoscriptsyntax as rs

def matlabIsInstalled():
    for path in os.environ["PATH"].split(";"):
        if os.path.isfile(os.path.join(path, "matlab.exe")):
            return True
    return False

UOfolder= GH.Folders.UserObjectFolders[0]+"LKplugin\\"

ML=open(UOfolder+"RammeLKpluginTemplate.m","r")
MLstring=ML.read()
ML.close()

MLstring = MLstring.replace("MatLabNodes",MatLabNodes)
MLstring = MLstring.replace("MatLabElements",MatLabElements)
MLstring = MLstring.replace("MatLabDOFS",MatLabDOFS)
MLstring = MLstring.replace("MatLabMaterial",MatLabMaterial)
MLstring = MLstring.replace("MatLabSupport",MatLabSupport)
MLstring = MLstring.replace("MatLabNodeLoads",MatLabNodeLoads)
MLstring = MLstring.replace("MatLabElementLoad",MatLabElementLoad)
MLstring = MLstring.replace("MatLabElementLoad",MatLabElementLoad)
MLstring = MLstring.replace("PlotScalingDeformation",str(PlotScalingDeformation[0]))
MLstring = MLstring.replace("PlotScalingForces",str(PlotScalingForces[0]))

tempFPath=UOfolder+"TempMLfile.m"

mFile=open(tempFPath,"w")
mFile.write(MLstring)
mFile.close()

print tempFPath

resultfile=UOfolder+"result.txt"
deformationfile=UOfolder+"deformation.txt"

deformationcurves=[]
if matlabIsInstalled():
    if run:
        subprocess.Popen("matlab -nosplash -nodesktop -minimize -r \"run "+tempFPath+"\"")

if os.path.isfile(resultfile) and os.path.isfile(deformationfile):
    if refresh:
        result=open(resultfile,"r")
        resultstring=result.read()
        result.close()
        resList=resultstring.split(",")
        V=[]
        Ru=[]
        F1=[]
        F2=[]
        M=[]
        listlist=[V,Ru,F1,F2,M]
        listCount=0
        for res in resList:
            if res[:1]=="/":
                listCount+=1
                res=res.replace("/","")
            listlist[listCount].append(res)
        
        deformation=open(deformationfile,"r")
        defstring=deformation.read()
        deformation.close()
        eleList=defstring.split("_")
        ptList=[]
        for ele in eleList:
            deformationpoints=[]
            if len(ele)>0:
                XYlist=ele.split("/")
                Xlist=XYlist[0].split(",")
                Ylist=XYlist[1].split(",")
            for i in range(len(Xlist)-1):
                deformationpoints.append(rs.AddPoint(float(Xlist[i]),float(Ylist[i]),0))
            deformationcurves.append(rs.AddInterpCurve(deformationpoints))
print deformationcurves
# ---------- end python_12 ----------
python_13 = PythonScript(resultfile=python_12.resultfile, deformationfile=python_12.deformationfile)  # -> out, deformationcurves, V, Ru, F1, F2, M; disabled
# ---------- python_13: Python ----------
import rhinoscriptsyntax as rs

result=open(resultfile,"r")
resultstring=result.read()
result.close()
resList=resultstring.split(",")
V=[]
Ru=[]
F1=[]
F2=[]
M=[]
listlist=[V,Ru,F1,F2,M]
listCount=0
for res in resList:
    if res[:1]=="/":
        listCount+=1
        res=res.replace("/","")
    listlist[listCount].append(res)


deformation=open(deformationfile,"r")
defstring=deformation.read()
deformation.close()
deformationcurves=[]
eleList=defstring.split("_")
ptList=[]
for ele in eleList:
    deformationpoints=[]
    if len(ele)>0:
        XYlist=ele.split("/")
        Xlist=XYlist[0].split(",")
        Ylist=XYlist[1].split(",")
    for i in range(len(Xlist)-1):
        print str(Xlist[i])+"  "+str(Ylist[i])
        deformationpoints.append(rs.AddPoint(float(Xlist[i]),float(Ylist[i]),0))
    deformationcurves.append(rs.AddInterpCurve(deformationpoints))
# ---------- end python_13 ----------
panel_16 = Panel("2.9968,2.6971,2.3974,2.0978,1.7981,1.4984,1.1987,0.8990,0.5994,0.2997,0.0000")
panel_17 = Panel("13.9299,14.1786,14.3231,14.3819,14.3732,14.3154,14.2270,14.1263,14.0316,13.9613,13.9337")
panel_18 = Panel(python_12.MLstring)
python_14 = PythonScript(run=Button())  # inputs run: Boolean
# ---------- python_14: Python ----------
import os
if run:
    os.startfile("C:\Users\Lasse\Desktop\RunMLscript.bat")
# ---------- end python_14 ----------
split = TextSplit(Text=panel_16, Separators=",")
split_2 = TextSplit(Text=panel_17, Separators=",")
pt_6 = ConstructPoint(XCoordinate=split_2, YCoordinate=split, ZCoordinate=0)

# ==== cluster Cluster
C = ClusterInput()
join = JoinCurves(Curves=C, Preserve=False)
item = ListItem(List=join, Index=Slider(0, range=0..100), Wrap=True)

explode = Explode(Curve=flatten(C), Recursive=True)  # -> Segments, Vertices
eval = EvaluateCurve(Curve=reparameterize(explode.Segments), Parameter=0.5)  # -> Point, Tangent, Angle
sort_pt = SortPoints(Points=flatten(eval.Point))  # -> Points, Indices
tstat = TreeStatistics(Tree=eval.Point)  # -> Paths, Length, Count
item_2 = ListItem(List=tstat.Paths, Index=sort_pt.Indices, Wrap=True)
branch = TreeBranch(Tree=explode.Segments, Path=item_2, MaintainPaths=False)
explode_2 = Explode(Curve=branch, Recursive=True)  # -> Segments, Vertices
sort_pt_2 = SortPoints(Points=flatten(explode_2.Vertices))  # -> Points, Indices
pdecon = Deconstruct(Point=sort_pt_2.Points)  # -> XComponent, YComponent, ZComponent
pt = ConstructPoint(XCoordinate=pdecon.XComponent, YCoordinate=pdecon.YComponent, ZCoordinate=0)
bbox = BoundingBox(Content=pt, Plane=PlaneXY(0, 0, 0), UnionBox=True)  # -> Box, Box_2
area = Area(Geometry=bbox.Box)  # -> Area, Centroid
division = Division(A=area.Area, B=1500)
cullpt = CullDuplicates(Points=pt, Tolerance=0.1, CullMode=3)  # -> Points, Indices, Valence
cp = ClosestPoint(Point=explode_2.Vertices, Cloud=cullpt.Points)  # -> ClosestPoint, CPIndex, Distance
eval_2 = EvaluateCurve(Curve=reparameterize(flatten(explode_2.Segments)), Parameter=0.5)  # -> Point, Tangent, Angle
item_3 = ListItem(List=cp.CPIndex, Index=0, Wrap=True)  # -> Item, Item1
points = PointList(Points=cullpt.Points, Size=division)
points_2 = PointList(Points=eval_2.Point, Size=division)
pt_2 = ConstructPoint(XCoordinate=item_3.Item, YCoordinate=item_3.Item1, ZCoordinate=0)  # -> flatten(Point)

python = PythonScript(incurves=join, keeporder=Toggle(False))  # -> out, b, sortedln; inputs incurves: list
# ---------- python: Python ----------
import rhinoscriptsyntax as rs

curves=[]
lines=[]

for crv in incurves:
    if rs.IsPolyline(crv) or rs.IsPolyCurve(crv):
        curves.extend(rs.ExplodeCurves(crv))
    else:
        curves.append(crv)

for curve in curves:
    lines.append(rs.AddLine(rs.CurveStartPoint(curve),rs.CurveEndPoint(curve)))

if not keeporder:
    points=[]
    indices=[]
    for line in lines:
        points.append(rs.CurveMidPoint(line))
    sortedpts=rs.SortPoints(points,True)
    for point in points:
        indices.append(sortedpts.index(point))
    sortin,sortedln = zip(*sorted(zip(indices, lines)))
# ---------- end python ----------
item_4 = ListItem(List=python.sortedln, Index=Slider(10, range=0..10), Wrap=True)
pline = PolyLine(Closed=False)
points_3 = PointList(Points=python.b, Size=Slider(2, range=0..10))
nodes = ClusterOutput(cullpt.Points)  # Node coordinates
topolist = ClusterOutput(pt_2)  # Point where x is index of element startpoint and y end point
